# Dynamo graph ViewTemplateNameChange.dyn (Dynamo 2.13.1.3887)

categories = Categories("OST_Views")  # graph input
all_elements_of_category = ElementsOfCategory(Category=categories)
watch = Watch(all_elements_of_category)
boolean = BoolSelector(false)
clean = List.Clean(list=all_elements_of_category, preserveIndices=boolean)
isViewTemplate = View.IsViewTemplate(view=clean)
filterByBoolMask = List.FilterByBoolMask(list=clean, mask=isViewTemplate)
name = Element.Name(element=filterByBoolMask.in)
watch_2 = Watch(name)
