# Dynamo graph 13.2-Warnings_Reset_Views.dyn (Dynamo 2.16.2.5624)
# packages: Clockwork for Dynamo 2.x 2.3.0

all_elements_in_active_view = ElementsInView()
current = Document.Current()
activeView = Document.ActiveView(document=current)
resetElementOverrides = Custom[View.ResetElementOverrides](element=all_elements_in_active_view, view=activeView)  # package Clockwork for Dynamo 2.x
