# Dynamo graph 15-MEP_CAD_SELECT_PIPES.dyn (Dynamo 2.16.2.5624)
# packages: bimorphNodes 5.1.3, MEPover 2024.9.25, archi-lab.net 2023.213.1722

select_model_element = DSModelElementSelection()  # 1 picked in the model
curvesFromCADLayers = CAD.CurvesFromCADLayers(importInstance=select_model_element)
select_model_element_2 = DSModelElementSelection()  # 1 picked in the model
type = archilab.Revit.Elements.Elements.Type(element=select_model_element_2)
categories = Categories("OST_PipingSystem")
all_elements_of_category = ElementsOfCategory(Category=categories)
integer_slider = IntegerSlider(1, range=0..2 step 1)
getItemAtIndex = List.GetItemAtIndex(list=all_elements_of_category, index=integer_slider)
type_2 = archilab.Revit.Elements.Elements.Type(element=getItemAtIndex)
levels = Levels("Level 1")
code_block = CodeBlock { 11; }
byLines = Custom[Pipe.ByLines](Lines=curvesFromCADLayers.Curve, PipeType=type, SystemType=type_2, level=levels, Diameter=code_block, lacing=Longest)  # package MEPover; Creates a pipe by Line, PipeType, SystemType, Level and Diameter
select_model_element_3 = DSModelElementSelection()  # 1 picked in the model
curvesFromCADLayers_2 = CAD.CurvesFromCADLayers(importInstance=select_model_element_3)
select_model_element_4 = DSModelElementSelection()  # 1 picked in the model
type_3 = archilab.Revit.Elements.Elements.Type(element=select_model_element_4)
categories_2 = Categories("OST_PipingSystem")
all_elements_of_category_2 = ElementsOfCategory(Category=categories_2)
integer_slider_2 = IntegerSlider(0, range=0..2 step 1)
getItemAtIndex_2 = List.GetItemAtIndex(list=all_elements_of_category_2, index=integer_slider_2)
type_4 = archilab.Revit.Elements.Elements.Type(element=getItemAtIndex_2)
levels_2 = Levels("Level 1")
code_block_2 = CodeBlock { 11; }
byLines_2 = Custom[Pipe.ByLines](Lines=curvesFromCADLayers_2.Curve, PipeType=type_3, SystemType=type_4, level=levels_2, Diameter=code_block_2, lacing=Longest)
